# Grasshopper definition TestFileCAM.gh (Grasshopper 1.0.8)
# plug-ins: Human, CamGh

panel = Panel("Offset")
cut_params = CutParameters(
    Stepover=Slider(50, range=0..100),
    Stepdown=Slider(50, range=0..100),
    Pattern=Slider(0, range=0..1),
    Engage="Ramp",
    Retract="Vertical",
    ClearanceMode="Automatic",
    ClearanceOffset=10,
    StockToLeave=Slider(1, range=0..1))  # -> CutParameters, Summary
machine = MachineSetup(Name="Default 3-axis", Units="Millimetres", SafeStartZ=0)
tool = Tool(Diameter=Slider(20, range=0..100), Shape="Flat", Flutes=2, RPM=18000)  # -> Tool, CuttingSpeed, Summary
mesh = Mesh(<mesh referenced from the Rhino model>)
preview = CustomPreview(Geometry=mesh, Material=ColourSwatch(SwatchColor=RGBA(255, 255, 120, 56)))
bbox = BoundingBox(Content=mesh, Plane=PlaneXY(0, 0, 0))  # -> Box, Box_2
stock = Stock(StockBox=bbox.Box)  # -> Stock, Summary
_3_2_finish = RegionFinishing(
    PartMesh=mesh,
    Tool=tool.Tool,
    CutParameters=cut_params.CutParameters,
    MaxOrientations=6,
    MaxWallAngle=75,
    SampleStep=0,
    OverlapRings=1,
    BorderSmoothing=16,
    PositionWeight=0.5)  # -> Command, Summary
_3_2_rough = MultiAxisRoughing(
    PartMesh=mesh,
    Tool=tool.Tool,
    CutParameters=cut_params.CutParameters,
    MaxOrientations=6,
    ToolReach=0,
    GridResolution=0,
    StockResolution=0)  # -> Command, Summary
cam_core = CAMCore(Commands=_3_2_finish.Command, Stock=stock.Stock)  # -> Toolpath, OperationResults, Summary, Engine, ToolAxes, ToolPlanes, StockPreview, Patches, TiltMap
cam_analysis = CAMAnalysis(OperationResults=cam_core.OperationResults)  # -> Report, RPM, CuttingSpeed, PathLevelZ, ContourPathPoints, ContourLines
pt = Point(cam_core.Toolpath)
intcrv = Interpolate(Vertices=pt, Degree="1", Periodic=False, KnotStyle=1)  # -> Curve, Length, Domain
branch = TreeBranch(Tree=intcrv.Curve, Path=Slider(3, range=0..10), MaintainPaths=True)
previewlw = CustomPreviewLineweights(Geometry=branch, Shader=ColourSwatch(SwatchColor=RGB(0, 119, 255)), Thickness=Slider(2, range=0..10), Absolute=False)
